# Dynamo graph GlasshouseDemoFile.dyn (Dynamo 1.3.3.4111)

apiKey = CodeBlock { "enter you api key here"; }
getProjects = GlasshouseDynamo.Projects.GetProjects(apiKey)
watch = Watch(getProjects.out2)
code_block = CodeBlock { 9; }
getItemAtIndex = List.GetItemAtIndex(list=getProjects.out1, index=code_block)
getProjectInfo = GlasshouseDynamo.Projects.GetProjectInfo(getProjects.out0, getItemAtIndex)
watch_2 = Watch(getProjectInfo.out2)
watch_3 = Watch(getProjectInfo.out1)
getJournalViews = GlasshouseDynamo.Views.GetJournalViews(getProjectInfo.out0, watch_3)
watch_4 = Watch(getJournalViews.out1)
code_block_2 = CodeBlock { 11; }
getItemAtIndex_2 = List.GetItemAtIndex(list=getJournalViews.out1, index=code_block_2)
getViewEntries = GlasshouseDynamo.JournalEntries.GetViewEntries(getJournalViews.out0, watch_3, getItemAtIndex_2)
watch_5 = Watch(getViewEntries.out1)
code_block_3 = CodeBlock { 0; 1; 2; 3; 4; }
getItemAtIndex_3 = List.GetItemAtIndex(list=getViewEntries.out2, index=code_block_3.out0)
watch_6 = Watch(getItemAtIndex_3)
getItemAtIndex_4 = List.GetItemAtIndex(list=getViewEntries.out2, index=code_block_3.out1)
watch_7 = Watch(getItemAtIndex_4)
getItemAtIndex_5 = List.GetItemAtIndex(list=getViewEntries.out2, index=code_block_3.out2)
watch_8 = Watch(getItemAtIndex_5)
getItemAtIndex_6 = List.GetItemAtIndex(list=getViewEntries.out2, index=code_block_3.out3)
watch_9 = Watch(getItemAtIndex_6)
getItemAtIndex_7 = List.GetItemAtIndex(list=getViewEntries.out2, index=code_block_3.out4)
watch_10 = Watch(getItemAtIndex_7)
getProjectsAllInfo = GlasshouseDynamo.Projects.GetProjectsAllInfo(apiKey)
watch_11 = Watch(getProjectsAllInfo.out2)
